# Grasshopper definition roller_definition.gh (Grasshopper 1.0.7)
# plug-ins: Kangaroo2 Components, Firefly.Core

list = ValueList({"28800", "38400", "57600", "115200"}, selected="115200")

# ----
# communicating with Arduino
# via serail port
# Check the BAUDRATE
ports_available = COMPortsAvailable()
panel = Panel(ports_available)
toggle = BooleanToggle(True)
timer = Timer(TimerInterval=100, Target=read)
select_the_right_port = ListItem(List=panel, Index=2, Wrap=True)
panel_2 = Panel(select_the_right_port)
open_port = OpenClosePort(OpenClosePort=toggle, PortNumber=panel_2, BaudRate=list)
read = SerialReadGeneric(StartReadingValues=toggle, PortNumber=panel_2)  # -> SerialOutput, StatusMessage
panel_3 = Panel(open_port)

# ----
# python code component.
# you can add outputs and inputs
# by zooming in and clicking the + signs
# in this toy example it does nothing really
# but it's a super easy way to parse the info
# coming from Arduino as strings
python = GhPythonScript(ard_in=read.SerialOutput)  # -> x, y, z
# ---------- python: Python ----------
import rhinoscriptsyntax as rs
import scriptcontext

if (x, y, z) not in globals():
    (x, y, z) = 0, 0, 0

if ard_in == 'up':
    z = z + 1
if ard_in == 'fw':
    x = x + 1
if ard_in == 'bw':
    x = x - 1
if ard_in == 'l':
    y = y - 1
if ard_in == 'r':
    y = y + 1
if ard_in == 'cw':   
    pass
if ard_in == 'ncw':
    pass
if ard_in == 'stable':
    pass
# ---------- end python ----------
x_coordinate = Panel(python.y)

panel_4 = Panel(read.SerialOutput)
y_coordinate = Panel(python.z)
vec = VectorXYZ(XComponent=x_coordinate, YComponent=y_coordinate, ZComponent=0)  # -> Vector, Length
brep = Brep([<brep referenced from the Rhino model> x2])
move = Move(Geometry=brep, Motion=vec.Vector)  # -> Geometry, Transform

# ----
# Change Difficulty
# Select Your Theme
# Play!
number_slider = Slider(13, range=5..15)

list_2 = ValueList({"Classy": 0, "Sassy": 1}, selected="Classy")

# ----
# Walls Radius
number_slider_2 = Slider(4, range=1..5)
multiplication = Multiplication(A=number_slider, B=number_slider_2)
dimensionsofgrid = Integer(20)
division = Division(A=dimensionsofgrid, B=multiplication)

mplane = MeshPlane(
    Boundary={Plane=PlaneXY(0, 0, 0), Size=Domain2(u=-10..10, v=-10..10)},
    WidthCount=number_slider,
    HeightCount=number_slider)  # -> Mesh, Area

c_script = CSharpScript(
    mesh=mplane.Mesh,
    seed=Slider(29, range=1..50),
    TooltipDescriptionOverride="V1.0 Laurent Delrieu l.delrieu@neuf.fr",
    TooltipTextOverride="Maze with mesh, recursive backtracker")  # -> out, Walls, Path, Begin, Goal; inputs mesh: Mesh, seed: Int32
# ---------- c_script: C# usings ----------
using System.IO;
using System.Linq;
using System.Data;
using System.Drawing;
using System.Reflection;
using System.Windows.Forms;
using System.Xml;
using System.Xml.Linq;
using System.Runtime.InteropServices;

using Rhino.DocObjects;
using Rhino.Collections;
using GH_IO;
using GH_IO.Serialization;
# ---------- c_script: C# ----------
    //Perfect maze on mesh using recursive backtracer
    //Laurent Delrieu
    //L.delrieu@neuf.fr
    //V1 : 13 of may 2016
    //References
    //  http://www.astrolog.org/labyrnth/algrithm.htm
    //  http://www.jamisbuck.org/mazes/
    //  http://elfnor.com/maze-any-mesh-in-blender.html
    //  http://www.grasshopper3d.com/forum/topics/wip-maze-definition
    //TODO
    // NGON mesh using Turtle, Plankton or new rhino 6 mesh
    // New strategy to change texture of maze, for example turn left...


    // List to know which faces were visited
    List<bool> visited_faces = new  List<bool>();
    for (int i = 0; i < mesh.Faces.Count; i++)
    {
      visited_faces.Add(false);
    }

    // List to know which edges were visited
    //Border edges could not be visited so they are considered visited
    List<bool> visited_edges = new  List<bool>();
    for (int i = 0; i < mesh.TopologyEdges.Count; i++)
    {
      int[] connectedFaces = mesh.TopologyEdges.GetConnectedFaces(i);
      if (connectedFaces.Length == 2) visited_edges.Add(false);
      else visited_edges.Add(false);
    }

    //List to maintain faces that were made
    List<LDFace> faces = new List<LDFace>();

    //We choose a random face
    Random rnd = new Random(seed);
    int rand_face = rnd.Next(mesh.Faces.Count);

    Random rnd2 = new Random(seed + 2);
    int rand_face2 = rnd2.Next(mesh.Faces.Count);
    //int rand_face2 = 1;

    //We choose an random edge
    int[] allEdges = mesh.TopologyEdges.GetEdgesForFace(rand_face);
    List<int> possibleEdges = new List<int>();
    for (int i = 0; i < allEdges.Length; i++)
    {
      int[] face_in_contact = mesh.TopologyEdges.GetConnectedFaces(allEdges[i]);
      if (face_in_contact.Length == 2) possibleEdges.Add(allEdges[i]);
    }
    //First face
    LDFace current_face = new LDFace(mesh, rand_face, -1, null, ref visited_edges, ref visited_faces);

    do
    {
      //Abort if escape pressed
      if (GH_Document.IsEscapeKeyDown()) GrasshopperDocument.RequestAbortSolution();

      //We add the current face to a list
      faces.Add(current_face);
      //Next face
      LDFace next_face = NextFace(current_face, mesh, ref visited_edges, ref visited_faces, rnd);

      //If no next face we go back until we find one or we arrive at the beginning
      if (next_face == null)
      {
        current_face = Back(current_face, mesh, ref visited_edges, ref visited_faces);
      }
      else
      {
        current_face = next_face;
      }
    }
      //Exit if we are at the beginning
    while (current_face.faceFrom != null);

    //Lines for drawing borders (excepts the edges)
    List<Line> lines = new List<Line>();
    for (int i = 0; i < mesh.TopologyEdges.Count; i++)
    {
      if (!visited_edges[i]) lines.Add(mesh.TopologyEdges.EdgeLine(i));
    }

    Walls = lines;
    Path = ToLines(faces);
    Begin = new Point3d(FaceCenter(mesh, rand_face));
    Goal = new Point3d(FaceCenter(mesh, rand_face2));
# ---------- c_script: C# additional code ----------
  //////////////////////////////////////////////
  public class LDFace
  {
    public int faceNumberOnMesh;
    public Point3d center;
    public List<LDFace> facesTo;
    public LDFace faceFrom;

    public LDFace(Mesh m, int face, int edge, LDFace face_from, ref List<bool> visited_edges, ref List<bool> visited_faces)
    {
      faceNumberOnMesh = face;
      faceFrom = face_from;
      center = new Point3d(FaceCenter(m, face));
      if (edge >= 0) visited_edges[edge] = true;
      visited_faces[face] = true;
    }
  }
  //////////////////////////////////////////////
  public static LDFace NextFace(LDFace face_from, Mesh m, ref List<bool> visited_edges, ref List<bool> visited_faces, Random rnd)
  {
    List<int> possibleEdges = new List<int>();
    List<int> possibleFaces = new List<int>();
    int edge;
    int face;
    //All edges around the current face
    int[] allEdges = m.TopologyEdges.GetEdgesForFace(face_from.faceNumberOnMesh);

    for (int i = 0; i < allEdges.Length; i++)
    {
      edge = allEdges[i];
      int[] face_in_contact = m.TopologyEdges.GetConnectedFaces(edge);
      //If edge is not a border
      if (face_in_contact.Length == 2)
      {
        if (face_in_contact[0] == face_from.faceNumberOnMesh) face = face_in_contact[1];
        else face = face_in_contact[0];

        if (!visited_edges[edge] && !visited_faces[face])
        {
          possibleEdges.Add(edge);
          possibleFaces.Add(face);
        }
      }
    }

    LDFace next_face = null;
    if (possibleEdges.Count > 0)
    {
      //Random choice
      int rand_index = rnd.Next(possibleFaces.Count);
      //generate lines on cube
      //int rand_index = 0;
      //int rand_index = possibleFaces.Count - 1;
      next_face = new LDFace(m, possibleFaces[rand_index], possibleEdges[rand_index], face_from, ref visited_edges, ref visited_faces);
    }
    return next_face;
  }
  //////////////////////////////////////////////
  public static LDFace Back(LDFace face_end, Mesh m, ref List<bool> visited_edges, ref List<bool> visited_faces)
  {
    LDFace face = face_end;
    bool asFreeEdge = false;

    do
    {
      face = face.faceFrom;
      int[] allEdges = m.TopologyEdges.GetEdgesForFace(face.faceNumberOnMesh);
      asFreeEdge = false;
      for (int i = 0; i < allEdges.Length; i++)
      {
        if (visited_edges[allEdges[i]] == false)
        {
          asFreeEdge = true;
        }
      }
    }
    while ((face.faceFrom != null) && !asFreeEdge);

    return face;
  }
  ///////////////////////////////////////////////
  public List<Line> ToLines(List<LDFace> faces)
  {
    List<Line> lines = new  List<Line>();
    for (int i = 0; i < faces.Count; i++)
    {
      if (faces[i].faceFrom != null) lines.Add(new Line(faces[i].center, faces[i].faceFrom.center));
    }
    return lines;
  }
  ///////////////////////////////////////////
  public static Point3d FaceCenter(Mesh mesh, int face)
  {
    Point3d pt = new Point3d(0, 0, 0);
    pt = pt + mesh.Vertices[mesh.Faces[face].A] + mesh.Vertices[mesh.Faces[face].B] + mesh.Vertices[mesh.Faces[face].C];
    if (mesh.Faces[face].IsQuad)
    {
      pt = pt + mesh.Vertices[mesh.Faces[face].D];
      pt = pt / 4.0;
    }
    else
    {
      pt = pt / 3.0;
    }
    return pt;
  }
# ---------- end c_script ----------

ballradius = Multiplication(A=division, B=Slider(0.791, range=0..1))

# ----
# MazeCase
division_2 = Division(A=dimensionsofgrid, B=2)
addition = Addition(A=ballradius, B=division_2)
neg = Negative(Value=addition)
neg_2 = Negative(Value=Slider(1.612, range=1..5))
dom = ConstructDomain(DomainStart=neg, DomainEnd=addition)
neg_3 = Negative(Value=ballradius)
dom_2 = ConstructDomain(DomainStart=neg_3, DomainEnd=neg_2)
box = DomainBox(Base=PlaneXY(0, 0, 0), X=dom, Y=dom, Z=dom_2)

squishyfactor = Slider(0.899, range=0.7..1)
Z = UnitZ(Factor=ballradius)
panel_5 = Panel(read.SerialOutput)
addition_2 = Addition(A=division, B=ballradius)
pointcoordinates = Addition(A=Z, B=c_script.Begin)
multiplication_2 = Multiplication(A=addition_2, B=squishyfactor)
collisionpipe = Pipe(Curve=c_script.Walls, Radius=multiplication_2, Caps=2)
visualpipe = Pipe(Curve=c_script.Walls, Radius=division, Caps=2)
python_2 = GhPythonScript(v=panel_4)  # -> out, r, l, fw, bw, up, _1, _2, _3, _4
# ---------- python_2: Python ----------
__author__ = "aeder"
__version__ = "2019.03.10"

import rhinoscriptsyntax as rs

r = (v=='r')
l = (v=='l')
fw = (v=='fw')
bw = (v=='bw')
up = (v=='up')
# ---------- end python_2 ----------

# ---- group: Key Detection
c_keypress = CSharpScript(Enable=Toggle(True))  # -> Up, Down, Left, Right; inputs Enable: Boolean
# ---------- c_keypress: C# ----------
    if (Enable && !subscribed)
    {
      Grasshopper.Instances.ActiveCanvas.KeyDown += OnKeyDown;
      Grasshopper.Instances.ActiveCanvas.KeyUp += OnKeyUp;
      subscribed = true;
    }
    else if (!Enable)
    {
      Grasshopper.Instances.ActiveCanvas.KeyDown -= OnKeyDown;
      Grasshopper.Instances.ActiveCanvas.KeyUp -= OnKeyUp;
      subscribed = false;
    }

    Up = up;
    Down = down;
    Left = left;
    Right = right;
# ---------- c_keypress: C# additional code ----------
  bool subscribed = false;
  bool up,down,left,right;

  void OnKeyDown(object sender, System.Windows.Forms.KeyEventArgs e)
  {
    switch (e.KeyCode) {
      case (System.Windows.Forms.Keys.Up):
        up = true;
        e.Handled = true;
        this.Component.ExpireSolution(true);
        break;

      case (System.Windows.Forms.Keys.Down):
        down = true;
        e.Handled = true;
        this.Component.ExpireSolution(true);
        break;

      case (System.Windows.Forms.Keys.Left):
        left = true;
        e.Handled = true;
        this.Component.ExpireSolution(true);
        break;

      case (System.Windows.Forms.Keys.Right):
        right = true;
        e.Handled = true;
        this.Component.ExpireSolution(true);
        break;
    }
  }

  void OnKeyUp(object sender, System.Windows.Forms.KeyEventArgs e)
  {
    switch (e.KeyCode) {
      case (System.Windows.Forms.Keys.Up):
        up = false;
        this.Component.ExpireSolution(true);
        break;

      case (System.Windows.Forms.Keys.Down):
        down = false;
        this.Component.ExpireSolution(true);
        break;

      case (System.Windows.Forms.Keys.Left):
        left = false;
        this.Component.ExpireSolution(true);
        break;

      case (System.Windows.Forms.Keys.Right):
        right = false;
        this.Component.ExpireSolution(true);
        break;
    }
  }
# ---------- end c_keypress ----------
merge = Merge(Data1=c_keypress.Up, Data2=c_keypress.Down, Data3=c_keypress.Left, Data4=c_keypress.Right, Data5=python_2.up)

# ----
Z_2 = UnitZ(Factor=100)

# ---- group: Direction Mapping
X = UnitX(Factor=1)
Y = UnitY(Factor=1)
neg_4 = Negative(Value=X)
neg_5 = Negative(Value=Y)
merge_2 = Merge(Data1=Y, Data2=neg_5, Data3=neg_4, Data4=X, Data5=Z_2)

# ----
panel_6 = Panel(python_2.l)
panel_7 = Panel(python_2.fw)
panel_8 = Panel(python_2.bw)

# ----
# finish
pt = Point(<point referenced from the Rhino model>)
python_3 = GhPythonScript()  # -> out, a, b, c
# ---------- python_3: Python ----------
__author__ = "yotam"
__version__ = "2019.03.08"

import rhinoscriptsyntax as rs
c = 0.1
extra = 0
b = 1.5

if(x):
    a = "yayy!! you made it!"
# ---------- end python_3 ----------
tag = TextTag3D(Location=pt, Text=python_3.a, Size=python_3.b, Colour=RGB(202, 193, 224), Justification=2)

panel_9 = Panel(python_2.r)
pt_2 = Point(<point referenced from the Rhino model>)
goal = Point(c_script.Goal)
list_3 = ValueList({"ScotsPine": "C:\Users\aeder\AppData\Roaming\McNeel\Rhinoceros\6.0\Localization\en-US\Render Content\Wood\Pine\ScotsPine polished.rmtl", "Aluminum": "C:\Users\aeder\AppData\Roaming\McNeel\Rhinoceros\6.0\Localization\en-US\Render Content\Metal\Polished\Polished Platinum.rmtl", "OregonPine": "C:\Users\aeder\AppData\Roaming\McNeel\Rhinoceros\6.0\Localization\en-US\Render Content\Wood\Pine\Oregon pine polished.rmtl", "RosePine": "C:\Users\aeder\AppData\Roaming\McNeel\Rhinoceros\6.0\Localization\en-US\Render Content\Wood\Pine\Rose pine polished.rmtl", "Anigre": "C:\Users\aeder\AppData\Roaming\McNeel\Rhinoceros\6.0\Localization\en-US\Render Content\Wood\Anigre polished.rmtl"}, selected="Aluminum")
# ScotsPine  = "C:\Users\aeder\AppData\Roaming\McNeel\Rhinoceros\6.0\Localization\en-US\Render Content\Wood\Pine\ScotsPine polished.rmtl"
# Aluminum   = "C:\Users\aeder\AppData\Roaming\McNeel\Rhinoceros\6.0\Localization\en-US\Render Content\Metal\Polished\Polished Platinum.rmtl"
# OregonPine = "C:\Users\aeder\AppData\Roaming\McNeel\Rhinoceros\6.0\Localization\en-US\Render Content\Wood\Pine\Oregon pine polished.rmtl"
# RosePine   = "C:\Users\aeder\AppData\Roaming\McNeel\Rhinoceros\6.0\Localization\en-US\Render Content\Wood\Pine\Rose pine polished.rmtl"
# Anigre     = "C:\Users\aeder\AppData\Roaming\McNeel\Rhinoceros\6.0\Localization\en-US\Render Content\Wood\Anigre polished.rmtl"
item = ListItem(List=list_3, Index=list_2, Wrap=True)
path = FilePath(item)
python_4 = GhPythonScript(x=panel_4)  # -> out, a
# ---------- python_4: Python ----------
__author__ = "aeder"
__version__ = "2019.03.10"

import rhinoscriptsyntax as rs

if x=='1':
    a = 'One!'
elif x=='2':
    a = 'Two!'
elif x=='3':
    a = 'Three!'
elif x=='4':
    a = 'Four!'
elif x=='up':
    a = 'GET UP!!'
# ---------- end python_4 ----------
multiplication_3 = Multiplication(A=ballradius, B=2)
multiplication_4 = Multiplication(A=ballradius, B=1.2)
sph = Sphere(Base=goal, Radius=multiplication_3)
tag_2 = TextTag3D(Location=PlaneXY(0, -15, 0), Text=python_4.a, Size=python_3.b, Colour=RGB(33, 25, 54), Justification=2)
brep_2 = Brep(sph)
cyl = Cylinder(Base=goal, Radius=multiplication_4, Length=0.5)
list_4 = ValueList({"Silver": "C:\Users\aeder\AppData\Roaming\McNeel\Rhinoceros\6.0\Localization\en-US\Render Content\Metal\Polished\Polished Silver.rmtl", "Aluminum": "C:\Users\aeder\AppData\Roaming\McNeel\Rhinoceros\6.0\Localization\en-US\Render Content\Metal\Polished\Polished Aluminum.rmtl", "Gold": "C:\Users\aeder\AppData\Roaming\McNeel\Rhinoceros\6.0\Localization\en-US\Render Content\Metal\Polished\Polished Gold.rmtl", "Fuchsia": "C:\Users\aeder\AppData\Roaming\McNeel\Rhinoceros\6.0\Localization\en-US\Render Content\Metal\Polished\Polished Fuchsia Anodized Aluminum.rmtl"}, selected="Silver")
circle = CircleCNR(Center=goal, Normal=Vector(0, 0, 1), Radius=multiplication_4)
cap = CapHoles(Brep=cyl)
Z_3 = UnitZ(Factor=0.1)
list_5 = ValueList({"Silver": "C:\Users\aeder\AppData\Roaming\McNeel\Rhinoceros\6.0\Localization\en-US\Render Content\Metal\Polished\Polished Silver.rmtl", "Fuchsia": "C:\Users\aeder\AppData\Roaming\McNeel\Rhinoceros\6.0\Localization\en-US\Render Content\Metal\Polished\Polished Fuchsia Anodized Aluminum.rmtl", "Aluminum": "C:\Users\aeder\AppData\Roaming\McNeel\Rhinoceros\6.0\Localization\en-US\Render Content\Metal\Polished\Polished Aluminum.rmtl", "Gold": "C:\Users\aeder\AppData\Roaming\McNeel\Rhinoceros\6.0\Localization\en-US\Render Content\Metal\Polished\Polished Gold.rmtl"}, selected="Gold")
path_2 = FilePath(list_4)
extr = Extrude(Base=circle, Direction=Z_3)
preview = CustomPreview(Geometry=extr, Material=ColourSwatch(SwatchColor=RGB(41, 24, 24)))

cull = CullPattern(List=merge_2, CullPattern=merge)
speed = Slider(0.004, range=0..0.01)
ma = MassAddition(Input=cull)  # -> Result, PartialResults
multiplication_5 = Multiplication(A=ma.Result, B=speed)
vec_2 = Vector(multiplication_5)
clean = CleanTree(RemoveNulls=True, RemoveInvalid=True, RemoveEmpty=False, Tree=vec_2)

# ---- group: Direction Force
pt_3 = Point(pointcoordinates)
load = Load(Point=pt_3, ForceVector=clean, Weighting=1)

# ---- group: Maze Geometry
maze = Brep(visualpipe)
spc = SolidPointCollide(Points=pt_3, Solid=collisionpipe, Interior=False, Unidirectional=True, Strength=1)
preview_2 = CustomPreview(Geometry=[box, visualpipe], Material=graft(path))

# ----
onplane = OnPlane(Points=pt_3, Plane=PlaneXY(0, 0, 0), Strength=0.2)
bouncysolver = BouncySolver(GoalObjects=[load, spc, onplane], Reset=Button(), Threshold=1e-15, Tolerance=0.01, Damping=0.99, Iterations=10, On=True)  # -> I, V, O

# ---- group: Success Condition
brepinc = PointInBrep(Brep=brep_2, Point=bouncysolver.V, Strict=False)
success = Geometry(cap)
cull_2 = CullPattern(List=success, CullPattern=brepinc)
preview_3 = CustomPreview(Geometry=cull_2, Material=list_5)

# ---- group: Player Preview
msphere = MeshSphere(Base=bouncysolver.V, Radius=ballradius, UCount=10, VCount=20)
preview_4 = CustomPreview(Geometry=msphere, Material=path_2)

# ----
python_5 = GhPythonScript(x=brepinc)  # -> out, a
# ---------- python_5: Python ----------
__author__ = "aeder"
__version__ = "2019.03.10"

import rhinoscriptsyntax as rs

a = "YOU WON!!!!!!!" if x else ''
# ---------- end python_5 ----------
tag_3 = TextTag3D(Location=PlaneXY(0, -15, 0), Text=python_5.a, Size=python_3.b, Colour=RGB(88, 35, 222), Justification=2)
